# Grasshopper definition bezier.gh (Grasshopper 1.0.4)
# Copyright: Arup
# plug-ins: HFTidyCanvas

pt = ConstructPoint(XCoordinate=0, YCoordinate=0, ZCoordinate=0)
point = DataDescription(pt)
number_slider = Slider(10, range=0..100)  # disabled
number_slider_2 = Slider(10, range=0..100)  # disabled
pt_2 = Point(<point referenced from the Rhino model>)  # disabled
pt_3 = Point(point)
number_slider_3 = DataDescription(Slider(1076, range=0..10000))
point_2 = DataDescription(pt_3)
perlin_is = GhPythonScript(n_div=number_slider, n_segments=number_slider_2)  # -> out, ys, xs; inputs n_div: Int32, n_segments: Int32; disabled
# ---------- perlin_is: Python ----------
# input n_div (int)
# input n_segments (int)

__author__ = "ismael.sanz"
__version__ = "2020.03.02"

from random import uniform

#defines 50% of the bezier curve
def bezier(x, u0, u1, u2, u3):
    step1 = u0*(1-x)**3
    step2 = 3*u1*((1-x)**2)*x
    step3 = 3*u2*(1-x)*x**2
    step4 = u3*x**3
    
    y = step1 + step2 + step3 + step4
    
    return y



def bezier_values(n_div):
    y = []
    y_reverse = []
    for i in range(n_div):
        y.append(bezier(i, 0, 0.05, 0.25, 1))
        y_reverse.append(bezier(i, 0, 0.05, 0.25, 1))
        
    
    
    height = y[-1] * 2
    y_reverse.reverse()
    
    del y[-1]
    
    for i in range(n_div):
        y.append(height - y_reverse[i])
    
    y_remap = []
    for value in y:
        OldMin = 0
        NewMin = 0
        OldMax = y[-1]
        NewMax = 1
        
        NewValue = (((value - OldMin) * (NewMax - NewMin)) / (OldMax - OldMin)) + NewMin
        y_remap.append(NewValue)
    
    return y_remap

y = bezier_values(n_div)

y_value = 0

# y values of the function
ys = []
# x values of the function
xs = []

for i in range(n_segments):
    
    x_int = uniform(0.2,1)
    y_int = uniform(10,50)
    
    if i%2 == 0:
        for i in range(len(y)):
            y_ = y_value + (y[i] * y_int)
            ys.append(y_)
            xs.append(x_int)
        y_value = y_
    else:
        for i in range(len(y)):
            y_ = y_value - (y[i] * y_int)
            ys.append(y_)
            xs.append(x_int)
        y_value = y_
# ---------- end perlin_is ----------
point_3 = DataDescription(pt_2)  # disabled
curve_perimeter = GhPythonScript(point=point_2, length=number_slider_3)  # -> out, pts, pt_start_last; inputs point: Point3d
# ---------- curve_perimeter: Python ----------
__author__ = "ismael.sanz"
__version__ = "2020.02.11"

import rhinoscriptsyntax as rs
from random import choice, uniform

start_y = point.Y
point_0 = point

limit = point.X + length
print limit
z_axis = rs.CreateVector(0,0,1)

detail = 10


x_mov = rs.CreateVector(detail,0,0)

go_bool = [True, True, True, True, False]

pts = []


while point.X<limit:
    go = choice(go_bool)
    if go:
        pass
    else:
        angle = -5
        while angle<0:
            rotation = uniform(90,-90)
            temp_mov = rs.VectorRotate(x_mov, rotation, z_axis)
            new_pt = rs.CopyObject(point, temp_mov)
            new_pt = rs.coerce3dpoint(new_pt)
            angle = new_pt.X - point.X
        x_mov = temp_mov
    point = rs.CopyObject(point, x_mov)
    
    pts.append(point)
    point = rs.coerce3dpoint(point)

limit = point.Y + length

x_mov = rs.CreateVector(0,detail,0)
while point.Y<limit:
    go = choice(go_bool)
    if go:
        pass
    else:
        angle = -5
        while angle<0:
            rotation = uniform(90,-90)
            temp_mov = rs.VectorRotate(x_mov, rotation, z_axis)
            new_pt = rs.CopyObject(point, temp_mov)
            new_pt = rs.coerce3dpoint(new_pt)
            angle = new_pt.Y - point.Y
        x_mov = temp_mov
    point = rs.CopyObject(point, x_mov)
    
    pts.append(point)
    point = rs.coerce3dpoint(point)
    

limit = point.X - length

x_mov = rs.CreateVector(-detail,0,0)
while point.X>limit:
    go = choice(go_bool)
    if go:
        pass
    else:
        angle = -5
        while angle<0:
            rotation = uniform(90,-90)
            temp_mov = rs.VectorRotate(x_mov, rotation, z_axis)
            new_pt = rs.CopyObject(point, temp_mov)
            new_pt = rs.coerce3dpoint(new_pt)
            angle = point.X - new_pt.X  
        x_mov = temp_mov
    point = rs.CopyObject(point, x_mov)
    
    pts.append(point)
    point = rs.coerce3dpoint(point)



# Last direction

vector_x = rs.VectorCreate(point, point_0)
dist_pts = rs.Distance(point, point_0)

pt_start_last = point

go_bool = ["rotate", "same", "go_to_origin"]


x_vec = rs.VectorUnitize(vector_x)
count = 0
count2 = 0
while dist_pts > 20:
    go = choice(go_bool)
    print go
    if go == "same":
        pass
    if go == "rotate":
        angle = -5
        while angle < 45:
            
            
            rotation = uniform(90,-90)
            temp_mv = rs.VectorRotate(x_vec, rotation, z_axis)
            new_pt = rs.CopyObject(point, temp_mv)
            new_pt = rs.coerce3dpoint(new_pt)
            
            v2 = rs.VectorCreate(new_pt, pt_start_last)
            
            angle = rs.VectorAngle(vector_x, v2)
            
            count2+=1
            if count2 == 100:
                break
                print "break"
                
        count2 = 0
        x_vec = rs.VectorUnitize(temp_mv) * detail
    if go == "go_to_origin":
        x_vec = rs.VectorCreate(point_0, point)
        x_vec = rs.VectorUnitize(x_vec) * detail
    
    point = rs.CopyObject(point, x_vec)
    pts.append(point)
    point = rs.coerce3dpoint(point)
    
    dist_pts = rs.Distance(point, point_0)
    
    print dist_pts
    count+=1
    if count == 1000:
        break
# ---------- end curve_perimeter ----------
series = Series(Start=0, Step=Slider(5, range=0..100), Count=Slider(285, range=0..1000))
ma = MassAddition(Input=perlin_is.xs)  # -> Result, PartialResults; disabled
Y = UnitY(Factor=series)
crv = Curve(<curve referenced from the Rhino model>)
Y_2 = UnitY(Factor=perlin_is.ys)  # disabled
X = UnitX(Factor=ma.PartialResults)  # disabled
dist = DataDescription(Slider(10, range=0..10))
pts = DataDescription(curve_perimeter.pts)
addition = Addition(A=Y_2, B=X)  # disabled
x_y_vetors = GhPythonScript(pts=pts, offset=Slider(168, range=0..200), dist=dist)  # -> out, x_left, x_right, y; inputs pts: list of Point3d
# ---------- x_y_vetors: Python ----------
__author__ = "user"
__version__ = "2020.03.08"

x = [pt.X for pt in pts]
y = [pt.Y for pt in pts]


# Get max and min x and y
x.sort()
y.sort()

x_left = x[0] - offset
x_right = x[-1] + offset
y_top = y[-1] + offset
y_btm = y[0] - offset


# Define how many times move the lines - vectors in y direction
y_dist = y_top - y_btm
y_dist = abs(y_dist)

n_times = int(y_dist/dist)

# Define the y vectors
y = []
for i in range(n_times):
    y.append(y_btm)
    y_btm+=dist
# ---------- end x_y_vetors ----------
pt_4 = Point([Point(10, 0, 0), Point(13.48265174, -9.373960576, 0), Point(16.96530347, -18.74792115, 0), Point(20.44795521, -28.12188173, 0), Point(23.93060695, -37.4958423, 0), Point(27.41325869, -46.86980288, 0)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])
move = Move(Geometry=crv, Motion=Y)  # -> graft(Geometry), Transform
move_2 = Move(Geometry=point_3, Motion=addition)  # -> Geometry, Transform; disabled
graph = GraphMapper(
    x0=0,
    x1=1,
    y0=0,
    y1=1,
    amplitude=0.3,
    container_name="Perlin",
    decay=0,
    frequency=0.07895028591,
    x_offset=0.5,
    y_offset=0.5)  # disabled
pline = PolyLine(Vertices=pt_4, Closed=True)
pts_2 = DataDescription(move_2.Geometry)  # disabled
pts_3 = DataDescription(move_2.Geometry)  # disabled
x_left = DataDescription(x_y_vetors.x_left)
x_right = DataDescription(x_y_vetors.x_right)
y = DataDescription(x_y_vetors.y)
item = ListItem(List=pts_3, Index=0, Wrap=True)  # -> Item1, Item; disabled
crv_2 = Curve(move.Geometry)
pdecon = Deconstruct(Point=item.Item1)  # -> XComponent, YComponent, ZComponent; disabled
pdecon_2 = Deconstruct(Point=item.Item)  # -> XComponent, YComponent, ZComponent; disabled
pt_5 = ConstructPoint(XCoordinate=x_left, YCoordinate=y, ZCoordinate=0)
pt_6 = ConstructPoint(XCoordinate=x_right, YCoordinate=y, ZCoordinate=0)
intcrv = Interpolate(Vertices=pts_3, Degree=3, Periodic=False, KnotStyle=1)  # -> Curve, Length, Domain; disabled
point_4 = DataDescription(pt_5)
point_5 = DataDescription(pt_6)
ln = Line(StartPoint=point_4, EndPoint=point_5)  # -> graft(Line)
merge = Merge(Data1=pdecon.XComponent, Data2=pdecon_2.XComponent)  # disabled
merge_2 = Merge(Data1=pdecon.YComponent, Data2=pdecon_2.YComponent)  # disabled
x = DataDescription(merge)  # disabled
y_2 = DataDescription(merge_2)  # disabled
pts_4 = Pts(pts)
sort = SortList(Keys=x)  # -> Keys, ValuesA; disabled
sort_2 = SortList(Keys=y_2)  # -> Keys, ValuesA; disabled
pline_2 = PolyLine(Vertices=pts, Closed=True)
item_2 = ListItem(List=sort.Keys, Index=0, Wrap=True)  # -> Item, Item1; disabled
item_3 = ListItem(List=sort_2.Keys, Index=0, Wrap=True)  # disabled
pts_5 = Pts(pts_4)
end = EndPoints(Curve=ln)  # -> Start, End
number_slider_4 = Slider(60, range=0..100)  # disabled
pt_7 = ConstructPoint(XCoordinate=item_2.Item, YCoordinate=item_3, ZCoordinate=0)  # disabled
pt_8 = ConstructPoint(XCoordinate=item_2.Item1, YCoordinate=item_3, ZCoordinate=0)  # disabled
pts_6 = Pts(pts_3)  # disabled
pdecon_3 = Deconstruct(Point=end.Start)  # -> XComponent, YComponent, ZComponent
pdecon_4 = Deconstruct(Point=end.End)  # -> XComponent, YComponent, ZComponent
dist_2 = Dist(dist)
shift = ShiftList(List=pts_5, Shift=1, Wrap=True)
shift_2 = ShiftList(List=pts_6, Shift=1, Wrap=True)  # disabled
number_slider_5 = Slider(156, range=0..1000)  # disabled
ln_2 = Line(StartPoint=pt_7, EndPoint=pt_8)  # disabled
pdecon_5 = Deconstruct(Point=pts_5)  # -> XComponent, YComponent, ZComponent
pdecon_6 = Deconstruct(Point=shift)  # -> XComponent, YComponent, ZComponent
panel = Panel(pdecon_3.XComponent)
divide = DivideCurve(Curve=ln_2, Count=number_slider_4, Kinks=False)  # -> Points, Tangents, Parameters; disabled
pdecon_7 = Deconstruct(Point=pts_6)  # -> XComponent, YComponent, ZComponent; disabled
pdecon_8 = Deconstruct(Point=pts_6)  # -> XComponent, YComponent, ZComponent; disabled
pdecon_9 = Deconstruct(Point=shift_2)  # -> XComponent, YComponent, ZComponent; disabled
in_or_out = GhPythonScript(
    x1=pdecon_3.XComponent,
    y1=pdecon_3.YComponent,
    x2=pdecon_4.XComponent,
    y2=pdecon_4.YComponent,
    x3=pdecon_5.XComponent,
    y3=pdecon_5.YComponent,
    x4=pdecon_6.XComponent,
    y4=pdecon_6.YComponent)  # -> out, insides, pts_x_int, pts_y_int; inputs x3: list, y3: list, x4: list, y4: list
# ---------- in_or_out: Python ----------
def line_intersection(line1, line2):
    xdiff = (line1[0][0] - line1[1][0], line2[0][0] - line2[1][0])
    ydiff = (line1[0][1] - line1[1][1], line2[0][1] - line2[1][1])

    def det(a, b):
        return a[0] * b[1] - a[1] * b[0]

    div = det(xdiff, ydiff)
    if div == 0:
       return False
       raise Exception('lines do not intersect')

    d = (det(*line1), det(*line2))
    x = det(d, xdiff) / div
    y = det(d, ydiff) / div
    
    return (x,y)


# Check that the point is inside the x and y boundaries
def in_curve((pt1, pt2, ptx)):
    x_values = [pt1[0], pt2[0]]
    x_values.sort()
    
    x_min = x_values[0]
    x_max = x_values[1]
    
    y_values = [pt1[1], pt2[1]]
    y_values.sort()
    
    y_min = y_values[0]
    y_max = y_values[1]
    
    # round number
    x_min = round(x_min, 3)
    x_max = round(x_max, 3)
    ptx_x = round(ptx[0], 3)
    
    y_min = round(y_min, 3)
    y_max = round(y_max, 3)
    ptx_y = round(ptx[1], 3)
    
    
    x_in = x_min <= ptx_x <= x_max
    y_in = y_min <= ptx_y <= y_max
    
    if x_in and y_in:
        return True
    else:
        return False


# pts as pt1 = (x, y)
def do_lines_intersect(pt1, pt2, pt3, pt4):
    
    pt_x = line_intersection((pt1, pt2), (pt3, pt4))
    if pt_x == False:
        return [False, (0,0)]
    
    in_line1 = in_curve((pt1, pt2, pt_x))
    if in_line1:
        in_line2 = in_curve((pt3, pt4, pt_x))
        if in_line2:
            inside = True
        else:
            inside = False
    else:
        inside = False
    
    return [inside, pt_x]


pts_x_in = []
pts_y_in = []

pts_x_int = []
pts_y_int = []

inside = False
insides = []

pts_x_int.append(x1)
pts_y_int.append(y1)


for i in range(len(x3)):
    #insert the first point
    
    intersect = do_lines_intersect((x1,y1), (x2,y2), (x3[i],y3[i]), (x4[i],y4[i]))
    if intersect[0]:
        print intersect
        pts_x_int.append(intersect[1][0])
        pts_y_int.append(intersect[1][1])
    
#insert the last point
pts_x_int.append(x2)
pts_y_int.append(y2)
# ---------- end in_or_out ----------
Y_3 = UnitY(Factor=number_slider_5)  # disabled
shift_3 = ShiftList(List=pdecon_8.XComponent, Shift=1, Wrap=True)  # disabled
panel_2 = Panel("-1")  # disabled
move_3 = Move(Geometry=divide.Points, Motion=Y_3)  # -> Geometry, Transform; disabled
panel_3 = Panel("""0
-1""")
sort_3 = SortList(Keys=in_or_out.pts_x_int, ValuesA=in_or_out.pts_y_int)  # -> Keys, ValuesA
cull_i = CullIndex(List=pdecon_7.XComponent, Indices=panel_2, Wrap=True)  # disabled
cull_i_2 = CullIndex(List=pdecon_9.XComponent, Indices=panel_2, Wrap=True)  # disabled
cull_i_3 = CullIndex(List=pdecon_7.YComponent, Indices=panel_2, Wrap=True)  # disabled
cull_i_4 = CullIndex(List=pdecon_9.YComponent, Indices=panel_2, Wrap=True)  # disabled
subtraction = Subtraction(A=shift_3, B=pdecon_8.XComponent)  # disabled
ln_3 = Line(StartPoint=move_3.Geometry, EndPoint=divide.Points)  # -> graft(Line); disabled
pt_9 = ConstructPoint(XCoordinate=sort_3.Keys, YCoordinate=sort_3.ValuesA, ZCoordinate=0)  # -> flatten(Point)
end_2 = EndPoints(Curve=ln_3)  # -> Start, End; disabled
cull_i_5 = CullIndex(List=sort_3.ValuesA, Indices=panel_3, Wrap=True)
cull_i_6 = CullIndex(List=sort_3.Keys, Indices=panel_3, Wrap=True)
panel_4 = Panel("""True
False""")
pt_10 = ConstructPoint(XCoordinate=cull_i_6, YCoordinate=cull_i_5, ZCoordinate=0)  # -> flatten(Point)
pdecon_10 = Deconstruct(Point=end_2.Start)  # -> XComponent, YComponent, ZComponent; disabled
pdecon_11 = Deconstruct(Point=end_2.End)  # -> XComponent, YComponent, ZComponent; disabled
number_slider_6 = Slider(37, range=0..100)  # disabled
number_slider_7 = Slider(139, range=0..250)  # disabled
number_slider_8 = Slider(65, range=0..100)  # disabled
dispatch = Dispatch(List=pt_10, DispatchPattern=[True, False])  # -> graft(ListA), graft(ListB)
dispatch_2 = Dispatch(List=pt_9, DispatchPattern=panel_4)  # -> graft(ListA), graft(ListB)
in_or_out_2 = GhPythonScript(
    x1=pdecon_10.XComponent,
    y1=pdecon_10.YComponent,
    x2=pdecon_11.XComponent,
    y2=pdecon_11.YComponent,
    x3=cull_i,
    y3=cull_i_3,
    x4=cull_i_2,
    y4=cull_i_4)  # -> out, pts_x_in, pts_y_in, lines, insides, pts_x_int, pts_y_int; inputs x3: list, y3: list, x4: list, y4: list; disabled
# ---------- in_or_out_2: Python ----------
def line_intersection(line1, line2):
    xdiff = (line1[0][0] - line1[1][0], line2[0][0] - line2[1][0])
    ydiff = (line1[0][1] - line1[1][1], line2[0][1] - line2[1][1])

    def det(a, b):
        return a[0] * b[1] - a[1] * b[0]

    div = det(xdiff, ydiff)
    if div == 0:
       return False
       raise Exception('lines do not intersect')

    d = (det(*line1), det(*line2))
    x = det(d, xdiff) / div
    y = det(d, ydiff) / div
    
    return (x,y)


# Check that the point is inside the x and y boundaries
def in_curve((pt1, pt2, ptx)):
    x_values = [pt1[0], pt2[0]]
    x_values.sort()
    
    x_min = x_values[0]
    x_max = x_values[1]
    
    y_values = [pt1[1], pt2[1]]
    y_values.sort()
    
    y_min = y_values[0]
    y_max = y_values[1]
    
    # Round the values in case the points are aligned but there's some minor problem with decimals
    x_min = round(x_min, 3)
    ptx_x = round(ptx[0], 3)
    x_max = round(x_max, 3)
    y_min = round(y_min, 3)
    ptx_y = round(ptx[1], 3)
    y_max = round(y_max, 3)
    
    x_in = x_min <= ptx_x <= x_max
    y_in = y_min <= ptx_y <= y_max
    
    #print [x_in, x_min, ptx_x, x_max]
    #print [y_in, y_min, ptx_y, y_max]
    
    
    
    if x_in and y_in:
        return True
    else:
        return False


# pts as pt1 = (x, y)
def do_lines_intersect(pt1, pt2, pt3, pt4):
    
    pt_x = line_intersection((pt1, pt2), (pt3, pt4))
    if pt_x == False:
        return [False, (0,0)]
    
    in_line1 = in_curve((pt1, pt2, pt_x))
    if in_line1:
        in_line2 = in_curve((pt3, pt4, pt_x))
        if in_line2:
            inside = True
        else:
            inside = False
    else:
        inside = False
    
    return [inside, pt_x]


pts_x_in = []
pts_y_in = []

pts_x_int = []
pts_y_int = []

for i in range(len(x3)):
    intersect = do_lines_intersect((x1,y1), (x2,y2), (x3[i],y3[i]), (x4[i],y4[i]))
    if intersect[0]:
        pts_x_int.append(intersect[1][0])
        pts_y_int.append(intersect[1][1])
# ---------- end in_or_out_2 ----------
boundary = BoundarySurfaces(Edges=pline_2)  # disabled
ln_4 = Line(StartPoint=dispatch.ListA, EndPoint=dispatch.ListB)  # -> flatten(Line)
ln_5 = Line(StartPoint=dispatch_2.ListA, EndPoint=dispatch_2.ListB)  # -> flatten(Line)
neg = Negative(Value=number_slider_6)  # disabled
item_4 = ListItem(List=boundary, Index=0, Wrap=True)  # disabled
dist_3 = Dist(dist_2)
pt_11 = ConstructPoint(XCoordinate=in_or_out_2.pts_x_int, YCoordinate=in_or_out_2.pts_y_int, ZCoordinate=0)  # disabled
end_3 = EndPoints(Curve=ln_4)  # -> Start, End
end_4 = EndPoints(Curve=ln_5)  # -> Start, End
v = DataDescription(number_slider_7)  # disabled
u = DataDescription(number_slider_8)  # disabled
offset = OffsetCurve(Curve=item_4, Distance=number_slider_6, Plane=PlaneXY(0, 0, 0), Corners=1)  # disabled
srf = Surface(<surface referenced from the Rhino model>)  # disabled
remap_pts_uv = GhPythonScript(pt1=end_3.Start, pt2=end_3.End, dist=dist_3)  # -> out, new_x, new_y; inputs pt1: Point3d, pt2: Point3d, dist: Int32
# ---------- remap_pts_uv: Python ----------
__author__ = "ismael.sanz"
__version__ = "2020.03.05"

# Define the points
pt1_x, pt1_y, pt2_x, pt2_y  = pt1.X, pt1.Y, pt2.X, pt2.Y

# Define the x domain
x_values = [pt1_x, pt2_x]
x_values.sort()

x_start = x_values[0]
x_end = x_values[1]

# I want to have points on the x=1, so in 1, 2, 3, 4...
x_start = int(x_start) 
x_end = int(x_end) 


# Look for multiples of the distance to start and end the curve
while x_start%dist!=0:
    x_start+=1

while x_end%dist!=0:
    x_end-=1

# We are getting horizontal lines so our y value must be same for both ends

new_x = [i for i in range(x_start, x_end, dist)]
if len(new_x) != 0:
    new_x[0] = x_start
    new_x.append(x_end)
new_y = [pt2_y for i in range(x_start, x_end, dist)]
# ---------- end remap_pts_uv ----------
remap_pts_uv_2 = GhPythonScript(pt1=end_4.Start, pt2=end_4.End, dist=dist_3)  # -> out, new_x, new_y; inputs pt1: Point3d, pt2: Point3d, dist: Int32; same code as remap_pts_uv
u_2 = DataDescription(number_slider_8)  # disabled
sdivide = DivideSurface(Surface=item_4, UCount=u, VCount=v)  # -> Points, Normals, Parameters; disabled
boundary_2 = BoundarySurfaces(Edges=flatten([offset, item_4]))  # disabled

# ---- group: length for each x line
dist_4 = Dist(flatten(remap_pts_uv.new_x))
cset = CreateSet(List=dist_4)  # -> Set, Map

# ----
sdivide_2 = DivideSurface(Surface=srf, UCount=u, VCount=v)  # -> Points, Normals, Parameters; disabled
neg_2 = Negative(Value=Slider(1, range=0..10))
u_3 = U(u_2)  # disabled
sort_4 = SortList(Keys=cset.Set)  # -> Keys, ValuesA
x_2 = DataDescription(remap_pts_uv.new_x)
all_x = DataDescription(sort_4.Keys)
y_3 = DataDescription(remap_pts_uv.new_y)
python = GhPythonScript(x=x_2, all_x=all_x)  # -> out, new_x; inputs x: list, all_x: list; disabled
# ---------- python: Python ----------
__author__ = "ismael.sanz"
__version__ = "2020.03.05"


new_x = []

for x_value in all_x:
    if x_value in x:
        new_x.append(x_value)
    else:
        new_x.append(None)
# ---------- end python ----------
x_coordinate = DataDescription(remap_pts_uv_2.new_x)
y_coordinate = DataDescription(remap_pts_uv_2.new_y)
z_coordinate = DataDescription(neg_2)
sdivide_3 = DivideSurface(Surface=boundary_2, UCount=u, VCount=v)  # -> Points, Normals, Parameters; disabled
perlin_is_2 = GhPythonScript(max_pts=u_3)  # -> out, ys, xs; disabled
# ---------- perlin_is_2: Python ----------
# input n_div (int)
# input n_segments (int)

__author__ = "ismael.sanz"
__version__ = "2020.03.02"

from random import uniform

#defines 50% of the bezier curve
def bezier(x, u0, u1, u2, u3):
    step1 = u0*(1-x)**3
    step2 = 3*u1*((1-x)**2)*x
    step3 = 3*u2*(1-x)*x**2
    step4 = u3*x**3
    
    y = step1 + step2 + step3 + step4
    
    return y



def bezier_values(n_div):
    y = []
    y_reverse = []
    for i in range(n_div):
        y.append(bezier(i, 0, 0.05, 0.25, 1))
        y_reverse.append(bezier(i, 0, 0.05, 0.25, 1))
        
    
    
    height = y[-1] * 2
    y_reverse.reverse()
    
    del y[-1]
    
    for i in range(n_div):
        y.append(height - y_reverse[i])
    
    y_remap = []
    for value in y:
        OldMin = 0
        NewMin = 0
        OldMax = y[-1]
        NewMax = 1
        
        NewValue = (((value - OldMin) * (NewMax - NewMin)) / (OldMax - OldMin)) + NewMin
        y_remap.append(NewValue)
    
    return y_remap



y_value = 0

# y values of the function
ys = []
# x values of the function
xs = []




adding_points = True

j = 0

while adding_points:
    
    n_div = uniform(7,20)
    
    n_div = int(n_div)
    y = bezier_values(n_div)
    
    
    x_int = 1
    y_int = uniform(10,50)
    
    if j%2 == 0:
        for i in range(len(y)):
            y_ = y_value + (y[i] * y_int)
            ys.append(y_)
            xs.append(x_int)
            
            if len(ys)==max_pts:
                adding_points = False
                break
            
            
        y_value = y_
    else:
        for i in range(len(y)):
            y_ = y_value - (y[i] * y_int)
            ys.append(y_)
            xs.append(x_int)
            if len(ys)==max_pts:
                adding_points = False
                break
        y_value = y_
    
    j+=1
# ---------- end perlin_is_2 ----------
pt_12 = ConstructPoint(XCoordinate=remap_pts_uv.new_x, YCoordinate=remap_pts_uv.new_y, ZCoordinate=0)
pt_13 = ConstructPoint(XCoordinate=x_coordinate, YCoordinate=y_coordinate, ZCoordinate=z_coordinate)
number_slider_9 = Slider(0.25, range=0..1)  # disabled
point_6 = DataDescription(pt_12)
point_7 = DataDescription(pt_13)
points = DataDescription(sdivide_3.Points)  # disabled
v_2 = V()  # disabled
ys = DataDescription(perlin_is_2.ys)  # disabled
number_slider_10 = Slider(34, range=0..100)  # disabled
perlin_is_3 = GhPythonScript(max_pts=v_2)  # -> out, ys, xs; disabled
# ---------- perlin_is_3: Python ----------
# input n_div (int)
# input n_segments (int)

__author__ = "ismael.sanz"
__version__ = "2020.03.02"

from random import uniform

#defines 50% of the bezier curve
def bezier(x, u0, u1, u2, u3):
    step1 = u0*(1-x)**3
    step2 = 3*u1*((1-x)**2)*x
    step3 = 3*u2*(1-x)*x**2
    step4 = u3*x**3
    
    y = step1 + step2 + step3 + step4
    
    return y



def bezier_values(n_div):
    y = []
    y_reverse = []
    for i in range(n_div):
        y.append(bezier(i, 0, 0.05, 0.25, 1))
        y_reverse.append(bezier(i, 0, 0.05, 0.25, 1))
        
    
    
    height = y[-1] * 2
    y_reverse.reverse()
    
    del y[-1]
    
    for i in range(n_div):
        y.append(height - y_reverse[i])
    
    y_remap = []
    for value in y:
        OldMin = 0
        NewMin = 0
        OldMax = y[-1]
        NewMax = 1
        
        NewValue = (((value - OldMin) * (NewMax - NewMin)) / (OldMax - OldMin)) + NewMin
        y_remap.append(NewValue)
    
    return y_remap



y_value = 0

# y values of the function
ys = []
# x values of the function
xs = []



# It creates the number of points as input: max_pts

# Change n_div for the number of division per curve
# Change y_int as the intensity of y values 

adding_points = True

j = 0

while adding_points:
    
    n_div = uniform(7,20)
    
    n_div = int(n_div)
    y = bezier_values(n_div)
    
    
    x_int = 1
    y_int = uniform(10,50)
    
    if j%2 == 0:
        for i in range(len(y)):
            y_ = y_value + (y[i] * y_int)
            ys.append(y_)
            xs.append(x_int)
            
            if len(ys)==max_pts:
                adding_points = False
                break
            
            
        y_value = y_
    else:
        for i in range(len(y)):
            y_ = y_value - (y[i] * y_int)
            ys.append(y_)
            xs.append(x_int)
            if len(ys)==max_pts:
                adding_points = False
                break
        y_value = y_
    
    j+=1
# ---------- end perlin_is_3 ----------
point_8 = Point(flatten(remap_pts_uv.new_x))
point_9 = Point(point_6)
bnd = Bounds(Numbers=ys)  # disabled
dom = ConstructDomain(DomainStart=0, DomainEnd=number_slider_10)  # disabled
cset_2 = CreateSet(List=point_8)  # -> Set, Map
remap = RemapNumbers(Value=ys, Source=bnd, Target=dom)  # -> Mapped, Clipped; disabled
pdecon_12 = Deconstruct(Point=point_9)  # -> XComponent, YComponent, ZComponent
python_2 = GhPythonScript()  # -> out, a
# ---------- python_2: Python ----------
__author__ = "ismael.sanz"
__version__ = "2020.03.05"

import rhinoscriptsyntax as rs

a = [1.3, 2.4, 3.4, 5]
dist = 5


for obj in a:
    obj = int(obj)
    while obj%dist!=0:
        obj += 1
    print obj
# ---------- end python_2 ----------
ys_2 = DataDescription(perlin_is_3.ys)  # disabled
xs = DataDescription(perlin_is_3.xs)  # disabled
sort_5 = SortList(Keys=cset_2.Set)  # -> Keys, ValuesA
x_component = DataDescription(pdecon_12.XComponent)
Z = UnitZ(Factor=remap.Mapped)  # disabled
bnd_2 = Bounds(Numbers=ys_2)  # disabled
dom_2 = ConstructDomain(DomainStart=0, DomainEnd=number_slider_10)  # disabled
total_xs = DataDescription(sort_5.Keys)
remap_2 = RemapNumbers(Value=ys_2, Source=bnd_2, Target=dom_2)  # -> Mapped, Clipped; disabled
Z_2 = UnitZ(Factor=remap_2.Mapped)  # disabled
lng = ListLength(List=total_xs)
move_4 = Move(Geometry=sdivide.Points, Motion=Z_2)  # -> Geometry, Transform; disabled
v_3 = V(lng)
series_2 = Series(Start=0, Step=1, Count=lng)
perlin_is_4 = GhPythonScript(max_pts=v_3)  # -> out, ys, xs; inputs max_pts: Int32
# ---------- perlin_is_4: Python ----------
# input n_div (int)
# input n_segments (int)

__author__ = "ismael.sanz"
__version__ = "2020.03.02"

from random import uniform


# If input is not integer then error
if isinstance(max_pts, int):
    pass
else:
    raise ValueError('Insert an integer')




#defines 50% of the bezier curve
def bezier(x, u0, u1, u2, u3):
    step1 = u0*(1-x)**3
    step2 = 3*u1*((1-x)**2)*x
    step3 = 3*u2*(1-x)*x**2
    step4 = u3*x**3
    
    y = step1 + step2 + step3 + step4
    
    return y



def bezier_values(n_div):
    y = []
    y_reverse = []
    for i in range(n_div):
        y.append(bezier(i, 0, 0.05, 0.25, 1))
        y_reverse.append(bezier(i, 0, 0.05, 0.25, 1))
        
    
    
    height = y[-1] * 2
    y_reverse.reverse()
    
    del y[-1]
    
    for i in range(n_div):
        y.append(height - y_reverse[i])
    
    y_remap = []
    for value in y:
        OldMin = 0
        NewMin = 0
        OldMax = y[-1]
        NewMax = 1
        
        NewValue = (((value - OldMin) * (NewMax - NewMin)) / (OldMax - OldMin)) + NewMin
        y_remap.append(NewValue)
    
    return y_remap



y_value = 0

# y values of the function
ys = []
# x values of the function
xs = []



# It creates the number of points as input: max_pts

# Change n_div for the number of division per curve
# Change y_int as the intensity of y values 

adding_points = True

j = 0

while adding_points:
    
    n_div = uniform(15,30)
    
    n_div = int(n_div)
    y = bezier_values(n_div)
    
    
    x_int = 1
    y_int = uniform(10,50)
    
    if j%2 == 0:
        for i in range(len(y)):
            y_ = y_value + (y[i] * y_int)
            ys.append(y_)
            xs.append(x_int)
            
            if len(ys)==max_pts:
                adding_points = False
                break
            
            
        y_value = y_
    else:
        for i in range(len(y)):
            y_ = y_value - (y[i] * y_int)
            ys.append(y_)
            xs.append(x_int)
            if len(ys)==max_pts:
                adding_points = False
                break
        y_value = y_
    
    j+=1
# ---------- end perlin_is_4 ----------
keys = DataDescription(sort_5.Keys)
values = DataDescription(series_2)
flip = FlipMatrix(Data=move_4.Geometry)  # disabled
keysearch = KeyValueSearch(Keys=keys, Values=values, Search=x_component)
ys_3 = DataDescription(perlin_is_4.ys)
move_5 = Move(Geometry=flip, Motion=Z)  # -> flatten(Geometry), Transform; disabled
dom_3 = ConstructDomain(DomainStart=Slider(1, range=0..10), DomainEnd=Slider(35, range=0..100))
bnd_3 = Bounds(Numbers=ys_3)
remap_3 = RemapNumbers(Value=ys_3, Source=bnd_3, Target=dom_3)  # -> Mapped, Clipped
geometry = DataDescription(move_5.Geometry)  # disabled
points_2 = Points(points)  # disabled
merge_3 = Merge(Data1=points_2, Data2=geometry)  # -> flatten(Result); disabled
z_values = DataDescription(remap_3.Mapped)
z_values_2 = Z_values(z_values)
del = DelaunayMesh(Points=merge_3, Plane=PlaneXY(0, 0, 0))  # disabled
item_5 = ListItem(List=z_values_2, Index=keysearch, Wrap=True)
point_10 = Point(point_9)
pts_7 = Pts(pts_4)
pdecon_13 = Deconstruct(Point=point_10)  # -> XComponent, YComponent, ZComponent
pt_14 = ConstructPoint(XCoordinate=pdecon_13.XComponent, YCoordinate=pdecon_13.YComponent, ZCoordinate=item_5)
point_11 = Point(point_7)
number_slider_11 = Slider(1, range=0..1)
item_6 = ListItem(List=pt_14, Index=0, Wrap=True)  # -> Item1, Item
start = DataDescription(item_6.Item)
end_5 = DataDescription(item_6.Item1)
end_6 = End(end_5)
start_2 = Start(start)
start_3 = DataDescription(item_6.Item)
end_7 = DataDescription(item_6.Item1)
pdecon_14 = Deconstruct(Point=end_6)  # -> XComponent, YComponent, ZComponent
neg_3 = Negative(Value=number_slider_11)
pdecon_15 = Deconstruct(Point=start_2)  # -> XComponent, YComponent, ZComponent
merge_4 = Merge(Data1=end_7, Data2=start_3)  # -> flatten(Result)
addition_2 = Addition(A=pdecon_14.XComponent, B=number_slider_11)
addition_3 = Addition(A=pdecon_15.XComponent, B=neg_3)
pts_border = DataDescription(merge_4)
pt_15 = ConstructPoint(XCoordinate=addition_2, YCoordinate=pdecon_14.YComponent, ZCoordinate=pdecon_14.ZComponent)
pt_16 = ConstructPoint(XCoordinate=addition_3, YCoordinate=pdecon_15.YComponent, ZCoordinate=pdecon_15.ZComponent)
pts_border_2 = Pts_border(pts_border)
clean = CleanTree(RemoveNulls=True, RemoveInvalid=True, RemoveEmpty=False, Tree=pts_border_2)
merge_5 = Merge(Data1=pt_15, Data2=pt_16)  # -> flatten(Result)
python_3 = GhPythonScript(Y=clean)  # -> Out, A
pts_border_3 = DataDescription(merge_5)
pdecon_16 = Deconstruct(Point=pts_border_3)  # -> XComponent, YComponent, ZComponent
pts_border_4 = Pts_border(pts_border)
pt_17 = ConstructPoint(XCoordinate=pdecon_16.XComponent, YCoordinate=pdecon_16.YComponent, ZCoordinate=0)
ln_6 = Line(StartPoint=pts_border_4, EndPoint=pt_17)
eval = EvaluateLength(Curve=ln_6, Length="0.5", Normalized=True)  # -> Point, Tangent, Parameter
clean_2 = CleanTree(RemoveNulls=True, RemoveInvalid=True, RemoveEmpty=False, Tree=eval.Point)
border_projected = DataDescription(clean_2)
border_projected_2 = Border_projected(pt_17)  # disabled
point_12 = DataDescription(pt_14)
point_13 = Point(point_11)
merge_6 = Merge(Data1=border_projected, Data2=pt_17)
merge_7 = Merge(Data1=point_12, Data2=point_13, Data3=border_projected_2)  # -> flatten(Result)
del_2 = DelaunayMesh(Points=merge_7, Plane=PlaneXY(0, 0, 0))
